# Grasshopper definition Envoltória triangular 1.gh (Grasshopper 1.0.7)
# plug-ins: LunchBox, OpenNest

espessura_dos_triângulos = Slider(0.21, range=0..1)
tamanho_dos_triângulos = Slider(0.85, range=0..1)
divisões_da_superfície = Slider(4, range=1..100)
tamanho_do_disco = Slider(0.93, range=0..1)
surface = Surface(<surface referenced from the Rhino model>)
braced_grid_1_d_structure = BracedGrid1DStructure(Surface=surface, UDivisions=divisões_da_superfície, VDivisions=divisões_da_superfície)  # -> PrimaryLines, BraceLines, StructureNodes
triangular_panels_a = TriangularPanelsA(Surface=surface, UDivisions=divisões_da_superfície, VDivisions=divisões_da_superfície)
area = Area(Geometry=triangular_panels_a)  # -> Area, Centroid
curve_middle = CurveMiddle(Curve=braced_grid_1_d_structure.BraceLines)
curve_middle_2 = CurveMiddle(Curve=braced_grid_1_d_structure.PrimaryLines)
scale = Scale(Geometry=triangular_panels_a, Center=area.Centroid, Factor=tamanho_dos_triângulos)  # -> Geometry, Transform
circle_cnr = CircleCNR(Center=curve_middle_2, Normal=braced_grid_1_d_structure.PrimaryLines, Radius=tamanho_do_disco)
circle_cnr_2 = CircleCNR(Center=curve_middle, Normal=braced_grid_1_d_structure.BraceLines, Radius=tamanho_do_disco)
vector = Vector(scale.Geometry)
vector_2 = Vector(scale.Geometry)
boundary_surfaces = BoundarySurfaces(Edges=circle_cnr)
boundary_surfaces_2 = BoundarySurfaces(Edges=circle_cnr_2)
multiplication = Multiplication(A=espessura_dos_triângulos, B=vector_2)
vector_3 = Vector(braced_grid_1_d_structure.PrimaryLines)
vector_4 = Vector(braced_grid_1_d_structure.BraceLines)
multiplication_2 = Multiplication(A=Slider(0.025, range=0..1), B=vector_3)
multiplication_3 = Multiplication(A=Slider(0.02, range=0..1), B=vector_4)
extrude = Extrude(Base=scale.Geometry, Direction=multiplication)
extrude_2 = Extrude(Base=boundary_surfaces_2, Direction=multiplication_3)
extrude_3 = Extrude(Base=boundary_surfaces, Direction=multiplication_2)
solid_difference = SolidDifference(BrepsA=extrude_3, BrepsB=extrude)
solid_difference_2 = SolidDifference(BrepsA=extrude_2, BrepsB=extrude)
list_length = ListLength(List=extrude)
repeat_data = RepeatData(Data="T", Length=list_length)  # -> graft(Data)
series = Series(Start=0, Step=1, Count=list_length)  # -> graft(Series)
evaluate_surface = EvaluateSurface(Surface=reparameterize(scale.Geometry), Point="0.5,0.5")  # -> Point, Normal, UDirection, VDirection, Frame
merge = Merge(Data1=repeat_data, Data2=series)
text_join = TextJoin(Text=merge)  # -> simplify(flatten(Result))
panel = Panel(text_join)
vector_5 = Vector(scale.Geometry)
text = Text(Location=evaluate_surface.Frame, Text=text_join, Size=Slider(0.32, range=0..1), Font="Arial")  # -> flatten(Curves)
multiplication_4 = Multiplication(A=vector_5, B=Slider(0.33, range=0..1))
extrude_4 = Extrude(Base=text, Direction=expr("x * -1", multiplication_4))
